# Dynamo graph formwork_m²_selecet.dyn (Dynamo 3.6.2.11575)

python_script = Python()  # CPython3
# ---------- python_script.python (1586 lines) ----------
# -*- coding: utf-8 -*-
# Revit 2025/2026 – Dynamo CPython3
# Formwork alan hesabı + parametre yaz + hesaplanan yüzeyleri boya — SEÇİLEN ELEMANLAR
#
# ═══════════════════════════════════════════════════════════════
# INPUTS:
#   IN[0] : Boş bırakıldı. Bu sürüm aktif Revit seçimini kullanır.
#   IN[1] : do_paint (bool, default=True)  – elemanları kırmızı override ile işaretle
#   IN[2] : use_selection (bool, default=True) – Bu sürümde varsayılan aktif seçimdir
#   IN[3] : grid_tol_m (float, default=0.09) – aks toleransı (metre)
#   IN[4] : slab_on_grade_elevation_m (float, default=None)
#             Bu kotun ±0.50m içindeki Floors → radye sayılır (alt yüzey hariç).
#             None verilirse kot kontrolü devre dışı.
#   IN[5] : slab_keywords (list[str] veya str, default=[])
#             Tip/aile adı eşleşen Floors → radye sayılır.
#             Örn: ["Radye", "Slab on Grade", "Foundation Slab"]
#   IN[6] : do_subtract (bool, default=False)
#             True → Revit JOIN tablosundaki komşu elemanların kesişimi çıkarılır.
#             Touching-but-not-joined / linked model / IFC kapsam dışı.
#             Büyük modellerde yavaşlayabilir. Varsayılan: False.
#
# KURALLAR:
#   Structural Columns        : YAN
#   Structural Framing (kiriş): YAN + ALT
#   Floors (döşeme)           : YAN + ALT
#   Floors (radye / zemin)    : SADECE YAN  ← IN[4] veya IN[5] ile tespit
#   Walls                     : YAN (tüm dikey yüzeyler)
#   Structural Foundations    : SADECE YAN (ALT YOK)
#
# ═══════════════════════════════════════════════════════════════
# PRODUCTION'A GEÇMEDEN ÖNCE — ZORUNLU KONTROLLER:
#
#   [ ] Shared Parameters doğru category binding'e atanmış
#   [ ] Schedule fields (Formwork_m², FW_L, FW_W, FW_H, FW_Level,
#       FW_Grid, FW_ElemId) manuel olarak Schedule'a eklenmiş
#   [ ] Project Units: m² ve metre olarak ayarlı
#   [ ] IFC / DirectShape elemanlarla test çalıştırıldı
#   [ ] 5–10 gerçek perde manuel doğrulaması yapıldı
#   [ ] do_subtract=False (default) bırakıldı  ← kritik
#   [ ] Büyük projede override performansı test edildi
#
# PRODUCTION NOTLARI:
#   do_subtract=False bırak:
#     Subtraction motoru topology-aware değil, multi-solid güvenilir değil,
#     linked model anlamıyor, bazı IFC'lerde boolean bozabiliyor.
#     Native temiz Revit RC modelde deneysel açılabilir ama
#     production default'u kesinlikle FALSE olmalı.
#
#   WALL(all_v) nedeniyle perde metrajını elle spot-check yap:
#     Kolon / kiriş / temel → oldukça güvenilir
#     Perde / duvar         → kontrollü kullanım, birkaç örnek doğrula
#
# GERÇEK KONUM:
#   "production helper tool"
#   Günlük kullanım, hızlı metraj, model kontrolü, formwork sanity-check,
#   IFC ön kontrol, saha yaklaşımı için yeterince olgunlaşmış.
#   Tam topology metraj motoru değil — ciddi iş gören mühendislik aracı.
# ═══════════════════════════════════════════════════════════════
#   hobby script                  : GEÇTİ
#   usable engineering tool       : EVET
#   production helper             : EVET
#   tam profesyonel metraj motoru : HAYIR
#   topology-aware engine         : HAYIR
#
# DOĞRULUK (gerçek saha tahmini):
#   Kolon                                    : %94–98
#   Kiriş                                    : %92–96
#   Temel                                    : %90–96
#   Döşeme / radye                           : %88–93
#   Duvar — düz, tekil                       : %82–90
#   Duvar — L/U/T                            : %65–82  ← review zorunlu
#   Curved wall                              : %50–75  ← riskli
#   IFC segmented wall                       : %55–80  ← riskli
#
# GÜÇLÜ YANLAR:
#   + DirectShape / IFC: Volume=0 solid + Mesh fallback
#   + GeometryInstance recursive traversal + GetSymbolGeometry fallback
#   + Category resolver: BIC int + Category.Name çift doğrulama
#   + Slab-on-grade tespiti: kot + anahtar kelime
#   + BBox fallback: kategori bazlı ayrı formüller
#   + Join subtraction: JoinGeometryUtils tabanlı, opsiyonel
#   + Face bazlı Paint (kalıp yüzeyi), Mesh/DS'de Override fallback
#   + Confidence scoring + explainable reasons + auto review_list
#   + Açık limitasyon belgesi
#
# EN DOĞRU KULLANIM (bu script neye uyar):
#   ✓ Hızlı formwork sanity-check
#   ✓ IFC QA ve ön metraj
#   ✓ Saha yaklaşım metrajı
#   ✓ Model kontrolü / quantity trend
#   ✓ Schedule automation (OUT[7] confidence, OUT[8] review)
#   ✗ Nihai hakediş / ihale metrajı
#   ✗ Topology-dependent kesin alan
#
# PRODUCTION WORKFLOW TAVSİYESİ:
#   1. do_subtract=False bırak (default) — boolean riski, IFC'de tehlikeli
#   2. Kolon / Kiriş / Temel → güvenilir, direkt kullanılabilir
#   3. Duvar / Perde       → review_list (OUT[8]) schedule'a bağla,
#                            manuel spot-check zorunlu
#   4. conf < 0.55 elemanlar → REVIEW etiketli, elle doğrula
#   5. IFC büyük model (10k+) → use_selection=True ile parça parça çalıştır
#
# ───────────────────────────────────────────────────────────────
# AÇIK LİMİTASYONLAR:
#
# [LIM-1] SUBTRACTION KISMİ — yardımcı özellik, true topology değil
#   do_subtract=True yalnızca JoinGeometryUtils.GetJoinedElements
#   kapsamındaki elemanları çıkarır. KAPSAM DIŞI:
#     - touching but not joined
#     - linked model intersection
#     - IFC implicit intersection
#     - nested family clash
#     - multi-solid interaction (_get_primary_solid sadece en büyük solid)
#     - opening-host interaction
#   Boolean difference invalid/non-manifold solid üretebilir;
#   _solid_has_faces kısmen yakalar ama geometry bozuksa bile
#   face var gibi görünebilir (IFC'de risk yüksek).
#   Gerçek sapma: %5–15, yoğun birleşimli projelerde daha fazla.
#
# [LIM-2] WALL = ALL_VERTICAL_FACES — en büyük hata kaynağı
#   Tüm dikey yüzeyler toplanır → her zaman "upper bound" verir.
#   Reveal, niche, opening jamb, join artifact, stacked wall seam,
#   IFC triangulation noise, curved wall segment faces dahil.
#   Senaryo bazlı risk:
#     düz perde / basit duvar      : iyi
#     L/U/T duvar                  : orta
#     opening-yoğun perde          : kötü
#     IFC segmented wall           : kötü
#     curved wall                  : riskli
#   Coplanar clustering denendi, kaldırıldı:
#     plane grouping ≠ shell reconstruction —
#     disconnected island aynı gruba düşer, bazı senaryolarda
#     ALL_VERTICAL_FACES'ten kötü sonuç veriyordu.
#   Gerçek çözüm: face connectivity graph + shell continuity +
#   opening-host intelligence → topology engine, kapsam dışı.
#
# [LIM-3] OVERRIDE-ONLY BOYAMA
#   Tüm eleman renklendirilir, yalnızca kalıp yüzleri değil.
#   "Element visualization", "face visualization" değil.
#
# [LIM-4] BBOX FALLBACK — eğimli elemanlarda büyütür
#   Geometry gelmezse BBox fallback devreye girer.
#   Eğimli elemanlarda BBox gerçek geometriyi büyütür.
#   "WARN:sloped_bbox_overestimate" ile işaretlenir.
#
# [LIM-5] FLOOR EDGE ŞİŞMESİ
#   Eğimli döşemede kenar alanı şişebilir.
#   BBox tahmininin %150'sini aşarsa "WARN:edge_inflated" eklenir.
#
# [LIM-6] TOPOLOGY YOK — sonraki büyük adım
#   Bu scriptte bulunmayan sistemler:
#     - face connectivity graph (shared edge kontrolü)
#     - shell continuity / reconstruction
#     - host opening intelligence (pencere/kapı/shaft semantic)
#     - topology cleanup / manifold repair
#     - adjacency graph / void propagation
#   Bu script: "geometry harvesting + rule-based area" seviyesindedir.
#   Kesin ihale/hakediş metrajı için elle doğrulama gerekir.
#
# ───────────────────────────────────────────────────────────────
# MEVCUT SEVİYE:
#   Hobby script                   : geçti
#   Engineering helper             : geçti
#   Production helper              : güçlü şekilde geçti
#   QA-assisted metraj tool        : EVET
#   Auditable engineering tool     : EVET
#   Topology engine                : HAYIR
#   Contract-grade quantity engine : HAYIR
#
#   Katman bazlı durum:
#     Geometry harvesting       : güçlü
#     Rule-based classification : güçlü
#     IFC tolerance             : iyi
#     QA explainability         : iyi   ← confidence + reasons + review_list
#     Semantic understanding    : sınırlı
#     Topology reconstruction   : yok
#
# SONRAKİ AŞAMA — KOD BÜYÜTME DEĞİL, STABİLİZASYON:
#   Daha fazla fallback/heuristic/if-else kodu şişirir,
#   topology eksikliğini gidermez.
#   Sonraki büyük sıçrama topology engine — Dynamo script değil,
#   ayrı geometri motoru gerektirir.
#
#   Öncelik sırası:
#     [ ] Yüksek: 20+ gerçek proje testi
#     [ ] Yüksek: IFC varyasyon testi (Tekla, Navis, Archicad)
#     [ ] Yüksek: Edge-case arşivi (beklenen/sonuç/sapma tablosu)
#     [ ] Yüksek: OUT[8] review_list ile QA review workflow
#     [ ] Orta:   Performans benchmark (5k–15k eleman)
#     [ ] Orta:   Karmaşık perde spot-check (L/U/curved/opening)
#     [ ] Orta:   Regression test seti
#     [ ] Düşük:  Yeni heuristic ekleme
# ═══════════════════════════════════════════════════════════════

import clr
import math

clr.AddReference("RevitAPI")
from Autodesk.Revit.DB import (
    FilteredElementCollector, Grid, Options, ViewDetailLevel,
    GeometryInstance, Solid, Mesh, Face, XYZ, UV, ElementId,
    Material, FillPatternElement, OverrideGraphicSettings, Color,
    BuiltInCategory, BuiltInParameter, StorageType, Element,
    UnitUtils, ForgeTypeId, SolidUtils, BooleanOperationsType,
    BooleanOperationsUtils, Transform
)

clr.AddReference("RevitServices")
from RevitServices.Persistence import DocumentManager
from RevitServices.Transactions import TransactionManager

clr.AddReference("RevitNodes")
import Revit
clr.ImportExtensions(Revit.Elements)

clr.AddReference("RevitAPIUI")
from Autodesk.Revit.UI import UIApplication

doc = DocumentManager.Instance.CurrentDBDocument
uiapp = DocumentManager.Instance.CurrentUIApplication
uidoc = uiapp.ActiveUIDocument

# ─────────────────────────── INPUTS ────────────────────────────
def _bool_safe(val, default=True):
    """'False' string dahil güvenli bool dönüşümü."""
    if val is None:
        return default
    if isinstance(val, bool):
        return val
    if isinstance(val, str):
        return val.strip().lower() not in ("false", "0", "no", "hayir", "hayır")
    return bool(val)

def _float_safe(val, default):
    try:
        return float(str(val).replace(",", "."))
    except:
        return default

# ─────────────────── BİRİM SABİTLERİ ───────────────────────────
FT2_TO_M2          = 0.09290304
FT_TO_M            = 0.3048
M_TO_FT            = 1.0 / FT_TO_M
NORMAL_Z_THRESHOLD = 0.6

# ─────────────────── PARAMETRE İSİMLERİ ────────────────────────
FORMWORK_PARAM_NAMES = ["Formwork_m²", "Formwork_m2", "Formwork_m2 "]
ELEMID_PARAM_NAMES   = ["FW_ElemId"]
GRID_PARAM_NAMES     = ["FW_Grid"]
LEVEL_PARAM_NAMES    = ["FW_Level"]
LENX_PARAM_NAMES     = ["FW_L"]
LENY_PARAM_NAMES     = ["FW_W"]
LENZ_PARAM_NAMES     = ["FW_H"]

# ─────────────────────────── INPUTS ────────────────────────────
elems_in      = IN[0] if len(IN) > 0 else None
do_paint      = _bool_safe(IN[1] if len(IN) > 1 else None, default=True)
use_selection = _bool_safe(IN[2] if len(IN) > 2 else None, default=True)
grid_tol_m    = _float_safe(IN[3] if len(IN) > 3 else None, default=0.09)
GRID_TOL_FT   = grid_tol_m * M_TO_FT

# Radye / zemin döşemesi tespiti
_sog_raw = IN[4] if len(IN) > 4 else None
SLAB_ON_GRADE_ELEV_M  = _float_safe(_sog_raw, default=None) if _sog_raw is not None else None
SLAB_ON_GRADE_ELEV_FT = (SLAB_ON_GRADE_ELEV_M * M_TO_FT) if SLAB_ON_GRADE_ELEV_M is not None else None
SLAB_ELEV_TOL_FT      = 0.5 * M_TO_FT  # ±0.50 m tolerans

_kw_raw = IN[5] if len(IN) > 5 else None
if _kw_raw is None:
    SLAB_KEYWORDS = []
elif isinstance(_kw_raw, str):
    SLAB_KEYWORDS = [k.strip() for k in _kw_raw.split(",") if k.strip()]
elif isinstance(_kw_raw, list):
    SLAB_KEYWORDS = [str(k).strip() for k in _kw_raw if str(k).strip()]
else:
    SLAB_KEYWORDS = []
SLAB_KEYWORDS_LOWER = [k.lower() for k in SLAB_KEYWORDS]

# IN[6]: do_subtract — join subtraction motoru
# True  → join edilmiş komşu elemanların kesişimi çıkarılır ([LIM-1] kısmi çözüm)
# False → subtraction yok, ham geometry kullanılır (varsayılan — daha hızlı)
# NOT: Subtraction Boolean işlem gerektirir, büyük modellerde yavaşlayabilir.
#      Linked model ve multi-join durumları kapsam dışındadır.
do_subtract = _bool_safe(IN[6] if len(IN) > 6 else None, default=False)

MAT_NAME  = "FW_FORMWORK_FACE_COLOR"
MAT_COLOR = Color(220, 30, 30)

# Gridleri bir kere topla
GRIDS = list(FilteredElementCollector(doc).OfClass(Grid).ToElements())

# ─────────────────────── YARDIMCI ──────────────────────────────
def unwrap(x):
    try:
        return UnwrapElement(x)
    except:
        return x

def eid_str(el):
    """ElementId değerini string olarak döndür (taşma riski yok)."""
    try:
        return str(el.Id.Value)
    except:
        try:
            return str(el.Id.IntegerValue)
        except:
            return ""

def eid_int(el):
    """ElementId'yi int olarak döndür."""
    try:
        return int(el.Id.Value)
    except:
        try:
            return int(el.Id.IntegerValue)
        except:
            return None

def cat_bic(el):
    """Elemanın BuiltInCategory int değerini döndür."""
    try:
        c = el.Category
        if c is None:
            return None
        try:
            return int(c.Id.Value)
        except:
            return int(c.Id.IntegerValue)
    except:
        return None

def find_param(el, names):
    for n in names:
        try:
            p = el.LookupParameter(n)
        except:
            p = None
        if p:
            return p, n
    return None, None

def _internal_length(m_value):
    """Metre → Revit iç birim (ft). UnitUtils yoksa manuel dönüşüm."""
    try:
        return UnitUtils.ConvertToInternalUnits(m_value, ForgeTypeId("autodesk.unit.unit:meters-1.0.1"))
    except:
        try:
            from Autodesk.Revit.DB import UnitTypeId
            return UnitUtils.ConvertToInternalUnits(m_value, UnitTypeId.Meters)
        except:
            return m_value * M_TO_FT

def set_param(p, str_val, int_val=None, double_internal=None):
    """Parametreyi StorageType'a göre yazar."""
    if p is None:
        return False, "param None"
    try:
        st = p.StorageType
        if st == StorageType.String:
            p.Set("" if str_val is None else str(str_val))
            return True, ""
        elif st == StorageType.Integer:
            v = int_val if int_val is not None else 0
            try:
                v = int(str(str_val))
            except:
                pass
            p.Set(int(v))
            return True, ""
        elif st == StorageType.Double:
            if double_internal is None:
                try:
                    double_internal = float(str(str_val).replace(",", "."))
                except:
                    double_internal = 0.0
            p.Set(float(double_internal))
            return True, ""
        else:
            p.SetValueString("" if str_val is None else str(str_val))
            return True, "SetValueString"
    except Exception as ex:
        return False, str(ex)

def fmt_m2(v, decimals=2, comma=True):
    try:
        s = "{:.{}f}".format(float(v), decimals)
        return s.replace(".", ",") if comma else s
    except:
        return ""

def bbox_sizes(el):
    """BoundingBox'tan (Lx_m, Ly_m, Lz_m, Lx_ft, Ly_ft, Lz_ft) döndür."""
    try:
        bb = el.get_BoundingBox(None)
    except:
        bb = None
    if not bb:
        return (0.0,)*6
    dx = abs(bb.Max.X - bb.Min.X)
    dy = abs(bb.Max.Y - bb.Min.Y)
    dz = abs(bb.Max.Z - bb.Min.Z)
    return (
        round(dx * FT_TO_M, 3),
        round(dy * FT_TO_M, 3),
        round(dz * FT_TO_M, 3),
        dx, dy, dz
    )

def bbox_center_pt(el):
    """BoundingBox merkez noktasını XYZ olarak döndür (fallback)."""
    try:
        bb = el.get_BoundingBox(None)
        if bb:
            return XYZ(
                (bb.Min.X + bb.Max.X) * 0.5,
                (bb.Min.Y + bb.Max.Y) * 0.5,
                (bb.Min.Z + bb.Max.Z) * 0.5
            )
    except:
        pass
    return None

def level_name(el):
    lvl = None
    try:
        lid = getattr(el, "LevelId", None)
        if isinstance(lid, ElementId) and lid != ElementId.InvalidElementId:
            lvl = doc.GetElement(lid)
    except:
        pass
    if not lvl:
        for bip in [
            BuiltInParameter.LEVEL_PARAM,
            BuiltInParameter.FAMILY_LEVEL_PARAM,
            BuiltInParameter.SCHEDULE_LEVEL_PARAM,
            BuiltInParameter.WALL_BASE_CONSTRAINT
        ]:
            try:
                p = el.get_Parameter(bip)
                if p:
                    eid = p.AsElementId()
                    if eid and eid != ElementId.InvalidElementId:
                        lvl = doc.GetElement(eid)
                        if lvl:
                            break
            except:
                pass
    try:
        return lvl.Name if lvl else ""
    except:
        return ""

def near_grids(el):
    """
    Elemana yakın aksları bulur.
    Önce LocationPoint/LocationCurve, bulunamazsa BoundingBox merkezi kullanır.
    """
    pts = []
    try:
        loc = el.Location
        if loc is not None:
            from Autodesk.Revit.DB import LocationPoint, LocationCurve
            if isinstance(loc, LocationPoint):
                pts.append(loc.Point)
            elif isinstance(loc, LocationCurve):
                crv = loc.Curve
                if crv:
                    pts.append(crv.Evaluate(0.5, True))
    except:
        pass

    # Fallback: BoundingBox merkezi
    if not pts:
        cpt = bbox_center_pt(el)
        if cpt:
            pts.append(cpt)

    if not pts or not GRIDS:
        return ""

    names = set()
    for g in GRIDS:
        try:
            gc = g.Curve
        except:
            gc = None
        if not gc:
            continue
        for pt in pts:
            try:
                proj = gc.Project(pt)
            except:
                proj = None
            if proj is None:
                continue
            try:
                d = proj.Distance
            except:
                d = None
            if d is None:
                continue
            if d <= GRID_TOL_FT:
                try:
                    names.add(g.Name)
                except:
                    pass
    return ", ".join(sorted(names)) if names else ""

# ─────────────── GEOMETRİ (Solid + Mesh, recursive) ───────────
def _solid_has_faces(solid):
    """Solid'in işlenebilir face'i var mı? Volume=0 DirectShape için kritik."""
    try:
        faces = solid.Faces
        if faces is None:
            return False
        # FaceArray boyutunu say
        count = 0
        for _ in faces:
            count += 1
            if count > 0:
                return True
        return False
    except:
        return False

_MAX_WALK_DEPTH = 8  # Sonsuz nested instance döngüsüne karşı koruma

def collect_geom_objects(el):
    opt = Options()
    opt.ComputeReferences = True
    opt.IncludeNonVisibleObjects = True
    opt.DetailLevel = ViewDetailLevel.Fine
    try:
        geo = el.get_Geometry(opt)
    except:
        geo = None
    out = []
    if geo is None:
        return out

    def walk(g, depth=0):
        if g is None or depth > _MAX_WALK_DEPTH:
            return
        if isinstance(g, GeometryInstance):
            before = len(out)
            try:
                inst = g.GetInstanceGeometry()
                if inst:
                    for gg in inst:
                        walk(gg, depth + 1)
            except:
                pass
            # Instance hiç solid/mesh üretmediyse symbol geometry dene
            # (import-family / DirectShape Volume=0 durumu)
            if len(out) == before:
                try:
                    sym = g.GetSymbolGeometry()
                    if sym:
                        for gg in sym:
                            walk(gg, depth + 1)
                except:
                    pass

        elif isinstance(g, Solid):
            # Volume=0 olsa bile face'leri olan solid'i işle (DirectShape)
            if _solid_has_faces(g):
                out.append(g)

        elif isinstance(g, Mesh):
            if g.NumTriangles > 0:
                out.append(g)

        else:
            # GeometryElement veya bilinmeyen nested tip
            try:
                for gg in g:
                    walk(gg, depth + 1)
            except:
                pass

    for obj in geo:
        walk(obj)
    return out

def tri_area_normal(p0, p1, p2):
    v1 = p1 - p0
    v2 = p2 - p0
    cr = v1.CrossProduct(v2)
    mag = cr.GetLength()
    if mag < 1e-12:
        return 0.0, None
    n = XYZ(cr.X / mag, cr.Y / mag, cr.Z / mag)
    return 0.5 * mag, n  # ft^2

# ─────────────── JOIN SUBTRACTION MOTORU ──────────────────────
# [LIM-1] için kısmi çözüm.
# Tam çözüm değil — sadece doğrudan join edilmiş komşuların
# kesişim hacmini çıkarır. Linked model ve karmaşık multi-join
# durumları kapsam dışıdır.

def _get_joined_element_ids(el):
    """Revit'te bu elemana join edilmiş element ID'lerini döndürür."""
    try:
        from Autodesk.Revit.DB import JoinGeometryUtils
        joined_ids = JoinGeometryUtils.GetJoinedElements(doc, el)
        return list(joined_ids) if joined_ids else []
    except:
        return []

def _get_primary_solid(el):
    """
    Elemanın en büyük solid'ini döndürür (Volume bazlı).
    Volume=0 solid'lerde face area toplamına geçer.
    Hiç solid yoksa None döner.

    RİSK: Multi-solid family / precast assembly / complex foundation
    durumlarında yalnızca en büyük parça kullanılır. Küçük ama
    önemli parçalar subtract edilmeden kalır. [LIM-1] kapsamında.
    """
    best = None
    best_score = -1.0
    for obj in collect_geom_objects(el):
        if not isinstance(obj, Solid):
            continue
        score = 0.0
        try:
            score = float(obj.Volume)
        except:
            pass
        if score < 1e-9:
            # Volume=0 (DirectShape vb.) → face area toplamı
            try:
                score = sum(float(f.Area) for f in obj.Faces)
            except:
                score = 0.0
        if score > best_score:
            best_score = score
            best = obj
    return best

def _solid_intersection_volume(solid_a, solid_b):
    """
    İki solid'in kesişim hacmini ft³ olarak döndürür.
    Başarısız olursa 0.0 döner (subtract işlemi atlanır).
    """
    try:
        intersection = BooleanOperationsUtils.ExecuteBooleanOperation(
            solid_a, solid_b, BooleanOperationsType.Intersect
        )
        if intersection is not None:
            return max(0.0, float(intersection.Volume))
    except:
        pass
    return 0.0

def _subtract_joined_solids(el, primary_solid):
    """
    Birincil solid'den join edilmiş komşu elemanların kesişimini çıkarır.
    Döndürür: (net_solid, subtracted_count, subtraction_notes)

    KAPSAM: Yalnızca JoinGeometryUtils.GetJoinedElements listesi.
    KAPSAM DIŞI: touching-but-not-joined, linked model, IFC implicit
    intersection, nested family clash, multi-solid interaction.

    RİSK: Boolean difference bazen invalid/non-manifold solid üretir.
    _solid_has_faces ile kısmen kontrol edilir ama geometry bozuk olsa
    da face var gibi görünebilir. Karmaşık IFC modellerinde dikkat.
    Hata durumunda primary_solid korunur (güvenli fallback).
    """
    if primary_solid is None:
        return None, 0, []

    joined_ids = _get_joined_element_ids(el)
    if not joined_ids:
        return primary_solid, 0, []

    net_solid = primary_solid
    ok_count  = 0
    notes     = []

    for jid in joined_ids:
        try:
            jel = doc.GetElement(jid)
            if jel is None:
                continue
            jsol = _get_primary_solid(jel)
            if jsol is None:
                continue

            # Kesişim hacmi yoksa çıkarma gereksiz
            iv = _solid_intersection_volume(net_solid, jsol)
            if iv < 1e-9:
                continue

            # Boolean difference
            result = BooleanOperationsUtils.ExecuteBooleanOperation(
                net_solid, jsol, BooleanOperationsType.Difference
            )
            if result is not None and _solid_has_faces(result):
                net_solid = result
                ok_count += 1
                notes.append("sub:Id{}(v={:.4f}ft3)".format(
                    str(jid.Value) if hasattr(jid, 'Value') else str(jid),
                    iv
                ))
            else:
                notes.append("sub_fail:Id{}".format(
                    str(jid.Value) if hasattr(jid, 'Value') else str(jid)
                ))
        except Exception as ex:
            notes.append("sub_ex:{}".format(str(ex)[:60]))

    return net_solid, ok_count, notes

def _safe_area(face):
    try:
        return float(face.Area)
    except:
        return 0.0

def _classify_solid_faces(solid, v_a, t_a, b_a, v_faces, b_faces, t_faces):
    """Tek bir solid'in face'lerini sınıflandırır. In-place günceller."""
    try:
        for face in solid.Faces:
            try:
                a = float(face.Area)
            except:
                continue
            if a < 1e-9:
                continue
            n = None
            try:
                bb = face.GetBoundingBox()
                uv = UV((bb.Min.U + bb.Max.U)*0.5, (bb.Min.V + bb.Max.V)*0.5)
                n = face.ComputeNormal(uv)
            except:
                pass
            if n is None:
                try:
                    n = face.ComputeNormal(UV(0.0, 0.0))
                except:
                    pass
            if n is None:
                for u_off, v_off in [(0.1,0.1),(0.9,0.1),(0.1,0.9)]:
                    try:
                        n = face.ComputeNormal(UV(u_off, v_off))
                        if n is not None:
                            break
                    except:
                        pass
            if n is None:
                v_a += a; v_faces.append(face)
                continue
            if n.Z > NORMAL_Z_THRESHOLD:
                t_a += a; t_faces.append(face)
            elif n.Z < -NORMAL_Z_THRESHOLD:
                b_a += a; b_faces.append(face)
            else:
                v_a += a; v_faces.append(face)
    except:
        pass
    return v_a, t_a, b_a

def classify_areas(el):
    """
    Yüzeyleri (v)ertical / (t)op / (b)ottom olarak ayırır.

    do_subtract=True ise join edilmiş komşu elemanların kesişimi
    önce primary solid'den çıkarılır, sonra face sınıflandırması yapılır.
    Subtraction başarısız olursa ham geometry kullanılır (güvenli fallback).

    Returns:
      v_area_ft2, t_area_ft2, b_area_ft2,
      v_faces, b_faces, t_faces,
      mesh_counts (tri_v, tri_b, tri_t),
      subtract_notes (list[str])
    """
    v_a = t_a = b_a = 0.0
    v_faces = []
    b_faces = []
    t_faces = []
    tri_v = tri_b = tri_t = 0
    subtract_notes = []

    geom_objects = collect_geom_objects(el)

    # ── JOIN SUBTRACTION ────────────────────────────────────────
    if do_subtract:
        # Primary solid'i bul
        primary = _get_primary_solid(el)
        if primary is not None:
            net_solid, sub_count, sub_notes = _subtract_joined_solids(el, primary)
            subtract_notes = sub_notes
            if sub_count > 0:
                # Subtraction başarılı → net solid'i kullan,
                # diğer solid'leri (varsa) ham haliyle ekle
                v_a, t_a, b_a = _classify_solid_faces(
                    net_solid, v_a, t_a, b_a, v_faces, b_faces, t_faces
                )
                # Birincil olmayan diğer solid'ler (zaten küçük parçalar)
                for obj in geom_objects:
                    if isinstance(obj, Solid) and obj is not primary:
                        v_a, t_a, b_a = _classify_solid_faces(
                            obj, v_a, t_a, b_a, v_faces, b_faces, t_faces
                        )
                # Mesh'ler her zaman eklenir
                for obj in geom_objects:
                    if isinstance(obj, Mesh):
                        try:
                            for i in range(obj.NumTriangles):
                                tri = obj.get_Triangle(i)
                                a, n = tri_area_normal(
                                    tri.get_Vertex(0), tri.get_Vertex(1), tri.get_Vertex(2)
                                )
                                if n is None or a <= 1e-12:
                                    continue
                                if n.Z > NORMAL_Z_THRESHOLD:
                                    t_a += a; tri_t += 1
                                elif n.Z < -NORMAL_Z_THRESHOLD:
                                    b_a += a; tri_b += 1
                                else:
                                    v_a += a; tri_v += 1
                        except:
                            pass
                return v_a, t_a, b_a, v_faces, b_faces, t_faces, \
                       (tri_v, tri_b, tri_t), subtract_notes
            # Subtraction başarısız → aşağıdaki normal yola düş

    # ── NORMAL YOL (subtraction yok veya başarısız) ─────────────
    for obj in geom_objects:
        if isinstance(obj, Solid):
            v_a, t_a, b_a = _classify_solid_faces(
                obj, v_a, t_a, b_a, v_faces, b_faces, t_faces
            )
        elif isinstance(obj, Mesh):
            try:
                for i in range(obj.NumTriangles):
                    tri = obj.get_Triangle(i)
                    a, n = tri_area_normal(
                        tri.get_Vertex(0), tri.get_Vertex(1), tri.get_Vertex(2)
                    )
                    if n is None or a <= 1e-12:
                        continue
                    if n.Z > NORMAL_Z_THRESHOLD:
                        t_a += a; tri_t += 1
                    elif n.Z < -NORMAL_Z_THRESHOLD:
                        b_a += a; tri_b += 1
                    else:
                        v_a += a; tri_v += 1
            except:
                pass

    return v_a, t_a, b_a, v_faces, b_faces, t_faces, \
           (tri_v, tri_b, tri_t), subtract_notes

# ─────────────────── BOYAMA / OVERRIDE ────────────────────────

def solid_fill_pattern_id():
    try:
        for fpe in FilteredElementCollector(doc).OfClass(FillPatternElement).ToElements():
            try:
                fp = fpe.GetFillPattern()
                if fp and fp.IsSolidFill:
                    return fpe.Id
            except:
                pass
    except:
        pass
    return ElementId.InvalidElementId

def _is_sloped_element(el, v_faces, b_faces, t_faces):
    """
    Elemanın eğimli olup olmadığını face normallerinden tespit eder.
    BBox oran heuristiği kaldırıldı (kaba, normal elemanları yanlış işaretleyebilir).

    Kural:
      - Yan sayılan face'lerde |nZ| > 0.05  → eğimli (yan yüzün Z bileşeni var)
      - Alt/üst face'lerde     |nZ| < 0.98  → eğimli (yatay yüzey tam yatay değil)
    Geometry yoksa (face listesi boş) → False döner, sloped flag verilmez.
    """
    for f in v_faces:
        try:
            bb = f.GetBoundingBox()
            uv = UV((bb.Min.U + bb.Max.U)*0.5, (bb.Min.V + bb.Max.V)*0.5)
            n  = f.ComputeNormal(uv)
            if n and abs(n.Z) > 0.05:
                return True
        except:
            pass
    for f in b_faces + t_faces:
        try:
            bb = f.GetBoundingBox()
            uv = UV((bb.Min.U + bb.Max.U)*0.5, (bb.Min.V + bb.Max.V)*0.5)
            n  = f.ComputeNormal(uv)
            if n and abs(n.Z) < 0.98:
                return True
        except:
            pass
    return False

def apply_override(el):
    """
    Elemanı aktif view'da kırmızı override ile işaretler.

    LIMITASYON: Bu yöntem tüm elemanı renklendirir, yalnızca
    hesaba giren yüzeyleri değil. "Element visualization" dir,
    "face visualization" değil. Performans ve Mesh/DirectShape
    uyumu için tercih edilmiştir (doc.Paint() kaldırıldı).
    """
    try:
        v = doc.ActiveView
        if v is None:
            return False, "NoActiveView"
        sfid = solid_fill_pattern_id()
        ogs = OverrideGraphicSettings()
        ogs.SetSurfaceForegroundPatternColor(MAT_COLOR)
        if sfid != ElementId.InvalidElementId:
            ogs.SetSurfaceForegroundPatternId(sfid)
        ogs.SetProjectionLineColor(MAT_COLOR)
        v.SetElementOverrides(el.Id, ogs)
        return True, "OverrideApplied"
    except Exception as ex:
        return False, "OverrideFail:{}".format(ex)

# ─────────────────── KATEGORİ TANIMLAMA ────────────────────────
# BIC id + kategori adı çift kontrol.
# int(BuiltInCategory.OST_*) CPython/Revit binding'ine göre tutarsız dönebilir;
# kategori adı (BuiltInCategory enum'unun string temsili) daha kararlıdır.
# Her kategori için (bic_int, ad_anahtar_kelimeleri) tuple listesi.

def _build_cat_map():
    """
    { "COLUMN": (bic_int_or_None, ["StructuralColumns", ...]), ... }
    BIC int'i başlangıçta bir kez hesapla; hata olursa None bırak.
    """
    def safe_int(bic_enum):
        try:
            return int(bic_enum)
        except:
            return None

    return {
        "COLUMN":     (safe_int(BuiltInCategory.OST_StructuralColumns),
                       ["OST_StructuralColumns", "StructuralColumns", "Structural Columns"]),
        "BEAM":       (safe_int(BuiltInCategory.OST_StructuralFraming),
                       ["OST_StructuralFraming", "StructuralFraming", "Structural Framing"]),
        "FLOOR":      (safe_int(BuiltInCategory.OST_Floors),
                       ["OST_Floors", "Floors"]),
        "WALL":       (safe_int(BuiltInCategory.OST_Walls),
                       ["OST_Walls", "Walls"]),
        "FOUNDATION": (safe_int(BuiltInCategory.OST_StructuralFoundation),
                       ["OST_StructuralFoundation", "StructuralFoundation",
                        "Structural Foundation", "Structural Foundations"]),
    }

_CAT_MAP = _build_cat_map()

def resolve_category(el):
    """
    Elemanın hangi kural kategorisine girdiğini döndürür.
    Önce BIC int eşleşmesi, sonra kategori adı eşleşmesi denenir.
    Döndürür: "COLUMN" | "BEAM" | "FLOOR" | "WALL" | "FOUNDATION" | "UNKNOWN"
    """
    bic_val = cat_bic(el)          # int veya None

    # Kategori adını güvenli al
    cat_name = ""
    try:
        c = el.Category
        if c is not None:
            cat_name = str(c.Name) if c.Name else ""
            # BuiltInCategory enum adını da dene (örn. "OST_Walls")
            try:
                bic_name = str(c.BuiltInCategory) if hasattr(c, "BuiltInCategory") else ""
            except:
                bic_name = ""
        else:
            bic_name = ""
    except:
        bic_name = ""

    for key, (expected_int, name_variants) in _CAT_MAP.items():
        # 1) BIC int eşleşmesi (None değilse ve -1 değilse)
        if expected_int is not None and expected_int != -1 and bic_val == expected_int:
            return key
        # 2) Kategori adı eşleşmesi (büyük/küçük harf duyarsız)
        cat_name_lower  = cat_name.lower()
        bic_name_lower  = bic_name.lower()
        for variant in name_variants:
            v = variant.lower()
            if v in cat_name_lower or v in bic_name_lower:
                return key

    return "UNKNOWN"

# ─────────────── RADYE / ZEMİN DÖŞEMESİ TESPİTİ ───────────────
def _elem_bottom_elevation_ft(el):
    """Elemanın alt kotunu ft cinsinden döndürür. Başarısızsa None."""
    try:
        bb = el.get_BoundingBox(None)
        if bb:
            return min(bb.Min.Z, bb.Max.Z)
    except:
        pass
    return None

def _elem_type_name(el):
    """Tip adı + aile adını birleştirip küçük harfe çevirir."""
    parts = []
    try:
        t = doc.GetElement(el.GetTypeId())
        if t:
            try:
                parts.append(str(t.Name))
            except:
                pass
            try:
                fn = t.get_Parameter(BuiltInParameter.ALL_MODEL_FAMILY_NAME)
                if fn:
                    parts.append(str(fn.AsString() or ""))
            except:
                pass
    except:
        pass
    try:
        parts.append(str(el.Name or ""))
    except:
        pass
    return " ".join(parts).lower()

def is_slab_on_grade(el):
    """
    Floors kategorisindeki elemanın radye / zemin döşemesi olup olmadığını
    iki yöntemle kontrol eder:
      1) Tip/aile adında SLAB_KEYWORDS_LOWER'dan herhangi biri geçiyorsa → True
      2) Elemanın alt kotu SLAB_ON_GRADE_ELEV_FT ± SLAB_ELEV_TOL_FT içindeyse → True
    Her iki kontrol da devre dışıysa (keyword listesi boş, kot None) → False
    """
    # 1) Anahtar kelime kontrolü
    if SLAB_KEYWORDS_LOWER:
        type_str = _elem_type_name(el)
        for kw in SLAB_KEYWORDS_LOWER:
            if kw in type_str:
                return True, "keyword:{}".format(kw)

    # 2) Kot kontrolü
    if SLAB_ON_GRADE_ELEV_FT is not None:
        bot = _elem_bottom_elevation_ft(el)
        if bot is not None:
            if abs(bot - SLAB_ON_GRADE_ELEV_FT) <= SLAB_ELEV_TOL_FT:
                return True, "elevation:{:.2f}m".format(bot * FT_TO_M)

    return False, ""
def bbox_fallback_area_ft2(el, cat_key):
    """
    Solid/Mesh geometry sıfır geldiğinde BoundingBox boyutlarından
    kurala uygun yüzey alanını hesaplar (ft²).

    Eksen tanımı:
      dx, dy → yatay boyutlar (plan kesiti)
      dz     → düşey yükseklik

    Kurallar:
      COLUMN     : 4 yan yüzey = 2*(dx+dy)*dz
      BEAM       : 2 yan yüzey + 1 alt yüzey
                   uzun eksen = length = max(dx,dy), genişlik = width = min(dx,dy)
                   = 2*(length*dz) + (length*width)
      FLOOR      : sadece yan kenar kalıbı (döşeme kenar tahtası) + alt yüzey
                   = 2*(dx+dy)*dz + dx*dy
                   (Foundation slab gibi davranmıyorsa sadece alt: dx*dy
                    — bu fonksiyon "yan+alt" döndürür; kurala göre üst çağıran seçer)
      WALL       : iki yan yüzey (her duvarın iki kalıp yüzü vardır)
                   duvarın uzun yüzü = max(dx*dz, dy*dz)
                   = 2 * max(dx*dz, dy*dz)
      FOUNDATION : sadece 4 yan yüzey (temel kenar kalıbı, alt yüzey yok)
                   = 2*(dx+dy)*dz
      FALLBACK   : 4 yan + alt = 2*(dx+dy)*dz + dx*dy
    """
    Lx_m, Ly_m, Lz_m, dx, dy, dz = bbox_sizes(el)

    if dx < 1e-6 and dy < 1e-6 and dz < 1e-6:
        return 0.0, "BBox_zero"

    if cat_key == "COLUMN":
        area = 2.0 * (dx + dy) * dz
        return area, "BBox_COLUMN"

    elif cat_key == "BEAM":
        # Kiriş yatay uzanır; uzun eksen length, kısa eksen width
        width  = min(dx, dy)
        length = max(dx, dy)
        # 2 yan yüzey (length*dz her biri) + 1 alt yüzey (length*width)
        area = 2.0 * (length * dz) + (length * width)
        return area, "BBox_BEAM"

    elif cat_key == "FLOOR":
        # Radye kontrolü BBox fallback'te de geçerli
        sog, sog_reason = is_slab_on_grade(el)
        if sog:
            area = 2.0 * (dx + dy) * dz
            return area, "BBox_FLOOR_SOG[{}]".format(sog_reason)
        else:
            area = 2.0 * (dx + dy) * dz + dx * dy
            return area, "BBox_FLOOR"

    elif cat_key == "WALL":
        # Duvar kalıbı her zaman iki yüz → 2 * büyük yüz alanı
        # (duvarın ince yönü kalınlık, uzun yönü ve yüksekliği kalıp yüzü)
        face_xz = dx * dz
        face_yz = dy * dz
        area = 2.0 * max(face_xz, face_yz)
        return area, "BBox_WALL"

    elif cat_key == "FOUNDATION":
        # Temel kenar kalıbı: sadece 4 yan yüzey, alt yüzey yok
        area = 2.0 * (dx + dy) * dz
        return area, "BBox_FOUNDATION"

    else:
        area = 2.0 * (dx + dy) * dz + dx * dy
        return area, "BBox_FALLBACK"

# ─────────────────── BOYAMA FONKSİYONLARI ──────────────────────
# Face bazlı Paint: sadece hesaba giren (kalıp yapılan) yüzeyleri boyar.
# Solid face'lerde çalışır. Mesh/DirectShape/BBox fallback durumunda
# paint başarısız olur → apply_override fallback devreye girer.

_paint_material_cache = [None]  # modül seviyesi cache — her run'da bir kez oluşturulur

def _get_or_create_paint_material():
    """FW_FORMWORK_FACE_COLOR materyalini döndürür veya oluşturur."""
    if _paint_material_cache[0] is not None:
        return _paint_material_cache[0]
    try:
        for m in FilteredElementCollector(doc).OfClass(Material).ToElements():
            if (m.Name or "") == MAT_NAME:
                _paint_material_cache[0] = m
                return m
        mid = Material.Create(doc, MAT_NAME)
        m = doc.GetElement(mid)
        try:
            m.Color = MAT_COLOR
        except:
            pass
        _paint_material_cache[0] = m
        return m
    except:
        return None

def _paint_faces(el, faces, mat_id):
    """
    Belirtilen face'leri mat_id ile boyar.
    Döndürür: (ok_count, fail_count, error_notes)
    Revit 2025'te IsPainted(ElementId, Face) imzası güvenli try/except ile kullanılır.
    """
    ok = fail = 0
    notes = []
    for f in faces:
        try:
            try:
                if doc.IsPainted(el.Id, f):
                    doc.RemovePaint(el.Id, f)
            except:
                pass
            doc.Paint(el.Id, f, mat_id)
            ok += 1
        except Exception as ex:
            fail += 1
            notes.append(str(ex)[:80])
    return ok, fail, notes

def apply_override(el):
    """
    Mesh/DirectShape/BBox fallback durumunda tüm elemanı override ile işaretler.
    Face bazlı Paint başarısız olduğunda fallback olarak çalışır.
    NOT: Tüm elemanı boyar, yalnızca kalıp yüzlerini değil. [LIM-3]
    """
    try:
        v = doc.ActiveView
        if v is None:
            return False, "NoActiveView"
        sfid = solid_fill_pattern_id()
        ogs = OverrideGraphicSettings()
        ogs.SetSurfaceForegroundPatternColor(MAT_COLOR)
        if sfid != ElementId.InvalidElementId:
            ogs.SetSurfaceForegroundPatternId(sfid)
        ogs.SetProjectionLineColor(MAT_COLOR)
        v.SetElementOverrides(el.Id, ogs)
        return True, "OverrideApplied"
    except Exception as ex:
        return False, "OverrideFail:{}".format(ex)


# ─────────────────── CONFIDENCE SCORING ───────────────────────
# "Bu sonuca ne kadar güveniyorum?"
# 0.0 (güvenilmez) – 1.0 (çok güvenilir)
# Döndürür: (score, reasons[]) — reasons açıklama listesi
#
# Puanlama:
#   1. Kategori taban puanı
#   2. BBox fallback → büyük düşüş
#   3. Eğimli eleman → düşüş
#   4. Mesh-only geometry → düşüş
#   5. WALL face density (face/ft²) — hardcoded eşik yerine yoğunluk
#   6. Edge inflated uyarısı → düşüş
#   7. Subtraction: native RC'de +, mesh/IFC'de nötr (boolean riski)

def _wall_face_density(v_face_count, bbox_v_area_ft2):
    """face/ft² — yüksekse reveal/jamb/artifact şişmesi ihtimali artar."""
    if bbox_v_area_ft2 < 1e-6 or v_face_count == 0:
        return 0.0
    return v_face_count / bbox_v_area_ft2

def _confidence(cat_key, is_bbox, is_sloped, tri_count,
                v_face_count, edge_inflated, has_sub,
                bbox_v_area_ft2=0.0, is_mesh_heavy=False):
    base = {
        "COLUMN":     0.95,
        "BEAM":       0.92,
        "FOUNDATION": 0.92,
        "FLOOR":      0.88,
        "WALL":       0.75,
        "UNKNOWN":    0.60,
    }
    score   = base.get(cat_key, 0.60)
    reasons = []

    if is_bbox:
        score -= 0.25
        reasons.append("bbox_fallback")

    if is_sloped:
        score -= 0.10
        reasons.append("sloped_element")

    if tri_count > 0 and v_face_count == 0:
        score -= 0.08
        reasons.append("mesh_only")
        is_mesh_heavy = True

    if cat_key == "WALL" and v_face_count > 0:
        density = _wall_face_density(v_face_count, bbox_v_area_ft2)
        if density > 1.0:
            score -= 0.12
            reasons.append("wall_high_face_density:{:.2f}/ft2".format(density))
        elif density > 0.5:
            score -= 0.06
            reasons.append("wall_med_face_density:{:.2f}/ft2".format(density))

    if edge_inflated:
        score -= 0.08
        reasons.append("edge_inflated")

    if has_sub:
        if is_mesh_heavy or is_bbox:
            pass  # nötr — boolean engine mesh/IFC'de riskli
        else:
            score += 0.03
            reasons.append("subtraction_applied+")

    return round(max(0.0, min(1.0, score)), 2), reasons

def _confidence_label(score):
    if score >= 0.90: return "HIGH"
    if score >= 0.75: return "MEDIUM"
    if score >= 0.55: return "LOW"
    return "REVIEW"

# ─────────────────── KURAL KARARI ──────────────────────────────
def decide(el):
    """
    Elemana ait kurala göre hesaplanacak alanı ve boyanacak face'leri döndürür.

    Geometry (Solid/Mesh) sıfır gelirse BBox fallback devreye girer ve
    metraj yine doğru hesaplanır. Bu durum debug'a 'BBOX_FALLBACK' olarak yazılır.
    Kategori tespiti BIC int + ad çift kontrolüyle yapılır.
    """
    v_a, t_a, b_a, v_f, b_f, t_f, tri_dbg, sub_notes = classify_areas(el)
    cat_key = resolve_category(el)
    cnts    = (len(v_f), len(b_f), len(t_f))
    areas   = (v_a, t_a, b_a)
    sub_tag = " [sub:{}]".format(len(sub_notes)) if sub_notes else ""

    # Kategoriye göre geometry'den hesaplanan alan
    if cat_key == "COLUMN":
        geo_area = v_a
        geo_faces = list(v_f)
        rule_base = "COLUMN(yan)"
    elif cat_key == "BEAM":
        geo_area  = v_a + b_a
        geo_faces = list(v_f) + list(b_f)
        rule_base = "BEAM(yan+alt)"
    elif cat_key == "FLOOR":
        # Radye / zemin döşemesi mi?
        sog, sog_reason = is_slab_on_grade(el)
        if sog:
            # Zemine oturur → alt yüzey kalıp yok, sadece yan
            geo_area  = v_a
            geo_faces = list(v_f)
            rule_base = "FLOOR_SOG(yan)[{}]".format(sog_reason)
        else:
            geo_area  = v_a + b_a
            geo_faces = list(v_f) + list(b_f)
            rule_base = "FLOOR(yan+alt)"
    elif cat_key == "WALL":
        # ALL_VERTICAL_FACES yaklaşımı.
        # Tüm dikey yüzeyler toplanır — her zaman "en az upper bound" verir.
        # [LIM-2]: reveal/niche/jamb/artifact şişirmesi mevcut.
        # Coplanar clustering kaldırıldı: plane grouping ≠ shell reconstruction,
        # disconnected island / curved / L-U-T / segmented wall senaryolarında
        # ALL_VERTICAL_FACES'ten daha kötü sonuç veriyordu.
        geo_area  = v_a
        geo_faces = list(v_f)
        rule_base = "WALL(all_v,cnt={})".format(len(v_f))

    elif cat_key == "FOUNDATION":
        geo_area  = v_a
        geo_faces = list(v_f)
        rule_base = "FOUNDATION(yan)"
    else:
        geo_area  = v_a + b_a
        geo_faces = list(v_f) + list(b_f)
        rule_base = "FALLBACK(yan+alt)"

    # ── FLOOR EDGE ŞİŞME KONTROLÜ ─────────────────────────────
    _, _, _, _dx, _dy, _dz = bbox_sizes(el)
    edge_inflated = False
    if cat_key == "FLOOR" and geo_area > 1e-9:
        bbox_edge_est = 2.0 * (_dx + _dy) * _dz
        if bbox_edge_est > 1e-9 and geo_area > bbox_edge_est * 1.5:
            rule_base = rule_base + " [WARN:edge_inflated]"
            edge_inflated = True

    # ── BBOX DİKEY ALAN (face density için) ─────────────────────
    # WALL confidence'ında face/ft² hesabı için bbox dikey alanı
    _bbox_v_area_ft2 = 2.0 * (max(_dx * _dz, _dy * _dz))  # iki büyük yüz

    # ── BBOX FALLBACK ─────────────────────────────────────────
    if geo_area < 1e-9:
        fallback_ft2, fallback_note = bbox_fallback_area_ft2(el, cat_key)
        is_sloped  = _is_sloped_element(el, v_f, b_f, t_f)
        slope_warn = " WARN:sloped_bbox_overestimate" if is_sloped else ""
        rule = "{} [{}{}]{}".format(rule_base, fallback_note, slope_warn, sub_tag)
        conf, conf_reasons = _confidence(
            cat_key, is_bbox=True, is_sloped=is_sloped,
            tri_count=sum(tri_dbg), v_face_count=len(v_f),
            edge_inflated=False, has_sub=bool(sub_notes),
            bbox_v_area_ft2=_bbox_v_area_ft2
        )
        return fallback_ft2, [], rule, cnts, areas, tri_dbg, sub_notes, (conf, conf_reasons)

    conf, conf_reasons = _confidence(
        cat_key, is_bbox=False,
        is_sloped=_is_sloped_element(el, v_f, b_f, t_f),
        tri_count=sum(tri_dbg), v_face_count=len(v_f),
        edge_inflated=edge_inflated, has_sub=bool(sub_notes),
        bbox_v_area_ft2=_bbox_v_area_ft2
    )
    return geo_area, geo_faces, rule_base + sub_tag, cnts, areas, tri_dbg, sub_notes, (conf, conf_reasons)

# ─────────────────── ELEMAN TOPLAMA ────────────────────────────
def collect_elements():
    """
    use_selection=True  → Revit aktif seçiminden al
    use_selection=False → IN[0]'dan al
    """
    if use_selection:
        try:
            sel_ids = uidoc.Selection.GetElementIds()
            return [doc.GetElement(i) for i in sel_ids if doc.GetElement(i) is not None]
        except Exception as ex:
            return []
    else:
        raw = elems_in
        if raw is None:
            return []
        if not isinstance(raw, list):
            raw = [raw]
        return [unwrap(x) for x in raw]

# ─────────────────────── ANA DÖNGÜ ─────────────────────────────
elements_out      = []
formwork_m2_list  = []
debug_list        = []
size_list         = []
level_list        = []
grid_list         = []
elemid_list       = []
confidence_list   = []  # OUT[7]: 0.0–1.0 confidence skoru
review_list       = []  # OUT[8]: conf < 0.55 olan eleman ID'leri (REVIEW)

elements = collect_elements()

if use_selection and not elements:
    debug_list.append("UYARI: Aktif Revit seçimi boş. Önce modelde elemanları seç, sonra Dynamo\'yu Manual Run ile çalıştır.")

TransactionManager.Instance.EnsureInTransaction(doc)

try:
    for el in elements:
        if not isinstance(el, Element):
            debug_list.append("Input not Element: {}".format(repr(el)))
            elements_out.append(None)
            formwork_m2_list.append(0.0)
            size_list.append((0.0, 0.0, 0.0))
            level_list.append("")
            grid_list.append("")
            elemid_list.append(None)
            confidence_list.append(0.0)
            continue

        eid_s = eid_str(el)
        eid_i = eid_int(el)
        elemid_list.append(eid_i)

        Lx_m, Ly_m, Lz_m, Lx_ft, Ly_ft, Lz_ft = bbox_sizes(el)
        lvl  = level_name(el)
        grid = near_grids(el)

        size_list.append((Lx_m, Ly_m, Lz_m))
        level_list.append(lvl)
        grid_list.append(grid)

        area_ft2, faces, rule, cnts, areas_dbg, tri_dbg, sub_notes, conf_tuple = decide(el)
        v_a, t_a, b_a = areas_dbg
        tri_v, tri_b, tri_t = tri_dbg
        v_c, b_c, t_c = cnts
        conf, conf_reasons = conf_tuple

        area_m2 = area_ft2 * FT2_TO_M2
        formwork_m2_list.append(round(area_m2, 2))
        confidence_list.append(conf)

        # AUTO REVIEW LIST: conf < 0.55 → manuel doğrulama önerilir
        if conf < 0.55:
            review_list.append("{} | Id={} | m2={} | conf={} | reasons={}".format(
                _confidence_label(conf), eid_s,
                fmt_m2(area_m2, 2, True), conf,
                ", ".join(conf_reasons) if conf_reasons else "none"
            ))

        # ── PARAMETRE YAZMA ──────────────────────────────────────
        # Formwork_m² → Double parametreyse iç birim ft², String ise virgüllü m²
        p_fw, n_fw = find_param(el, FORMWORK_PARAM_NAMES)
        if p_fw:
            ok, msg = set_param(
                p_fw,
                str_val=fmt_m2(area_m2, 2, True),
                double_internal=area_ft2
            )
            if not ok:
                debug_list.append("Id {} | Formwork FAIL ({}): {}".format(eid_s, n_fw, msg))
        else:
            debug_list.append("Id {} | UYARI: Formwork param yok".format(eid_s))

        # FW_L / FW_W / FW_H → ft cinsinden iç birim
        for names, val_m, label in [
            (LENX_PARAM_NAMES, Lx_m, "FW_L"),
            (LENY_PARAM_NAMES, Ly_m, "FW_W"),
            (LENZ_PARAM_NAMES, Lz_m, "FW_H"),
        ]:
            p, n = find_param(el, names)
            if p:
                ok, msg = set_param(
                    p,
                    str_val=fmt_m2(val_m, 3, True),
                    double_internal=_internal_length(val_m)
                )
                if not ok:
                    debug_list.append("Id {} | {} FAIL ({}): {}".format(eid_s, label, n, msg))

        # FW_Level / FW_Grid → Text
        p_lvl, _ = find_param(el, LEVEL_PARAM_NAMES)
        if p_lvl:
            ok, msg = set_param(p_lvl, str_val=lvl or "")
            if not ok:
                debug_list.append("Id {} | FW_Level FAIL: {}".format(eid_s, msg))

        p_gr, _ = find_param(el, GRID_PARAM_NAMES)
        if p_gr:
            ok, msg = set_param(p_gr, str_val=grid or "")
            if not ok:
                debug_list.append("Id {} | FW_Grid FAIL: {}".format(eid_s, msg))

        # FW_ElemId → Integer veya String
        p_eid, _ = find_param(el, ELEMID_PARAM_NAMES)
        if p_eid:
            ok, msg = set_param(
                p_eid,
                str_val=eid_s,
                int_val=eid_i if eid_i is not None else 0
            )
            if not ok:
                debug_list.append("Id {} | FW_ElemId FAIL: {}".format(eid_s, msg))

        # ── BOYAMA ───────────────────────────────────────────────
        # Önce decide() tarafından seçilen face'leri doc.Paint() ile boya.
        # Bu sadece kalıp yapılacak yüzeyleri renklendirir (beton gören yüzler).
        # Solid face'lerde çalışır. Mesh/DirectShape/BBox fallback durumunda
        # paint başarısız olur → tüm eleman override'a düşer (fallback).
        paint_ok = paint_fail = 0
        paint_note = ""

        if do_paint:
            if faces:
                mat = _get_or_create_paint_material()
                if mat is not None:
                    paint_ok, paint_fail, paint_notes = _paint_faces(el, faces, mat.Id)
                    if paint_fail > 0:
                        paint_note = paint_notes[0] if paint_notes else "PaintFail"

            # Face paint olmadıysa (Mesh/DirectShape/BBox fallback) override uygula
            if paint_ok == 0:
                ov_ok, ov_msg = apply_override(el)
                paint_note = (paint_note + " | OverrideFallback:" + ov_msg).strip(" |")

        # ── ÇIKIŞA EKLE ──────────────────────────────────────────
        try:
            elements_out.append(el.ToDSType(True))
        except:
            elements_out.append(el)

        # Tanı için kategori adını da al
        try:
            _cat_name_dbg = el.Category.Name if el.Category else "?"
        except:
            _cat_name_dbg = "?"

        debug_list.append(
            "Id={} | {} | CAT_BIC={} CAT_NAME='{}' | "
            "area_ft2(v/t/b)={:.3f}/{:.3f}/{:.3f} | m2={} | "
            "conf={} ({}) reasons=[{}] | "
            "faces(v/b/t)={}/{}/{} | meshTri(v/b/t)={}/{}/{} | "
            "paint_ok={} paint_fail={} | note={} | "
            "sub={} | "
            "size(m)=({},{},{}) | Level='{}' | Grid='{}'".format(
                eid_s, rule, cat_bic(el), _cat_name_dbg,
                v_a, t_a, b_a,
                fmt_m2(area_m2, 2, True),
                conf, _confidence_label(conf),
                ", ".join(conf_reasons) if conf_reasons else "ok",
                v_c, b_c, t_c,
                tri_v, tri_b, tri_t,
                paint_ok, paint_fail, paint_note,
                "; ".join(sub_notes) if sub_notes else "none",
                str(Lx_m).replace(".", ","),
                str(Ly_m).replace(".", ","),
                str(Lz_m).replace(".", ","),
                lvl, grid
            )
        )

except Exception as main_ex:
    debug_list.append("KRITIK HATA: {}".format(main_ex))
    TransactionManager.Instance.ForceCloseTransaction()
    raise

TransactionManager.Instance.TransactionTaskDone()

# ─────────────────────── ÇIKIŞLAR ──────────────────────────────
# OUT[0] : Elemanlar (Dynamo nesneleri)
# OUT[1] : Formwork m² listesi
# OUT[2] : Debug mesajları (conf + reasons dahil)
# OUT[3] : Boyut listesi [(Lx,Ly,Lz), ...]
# OUT[4] : Kat isimleri
# OUT[5] : Aks isimleri
# OUT[6] : Element ID listesi
# OUT[7] : Confidence skoru listesi [0.0–1.0]
#            0.90+ HIGH   → güvenilir
#            0.75+ MEDIUM → normal kontrol
#            0.55+ LOW    → dikkatli kullan
#            <0.55 REVIEW → manuel doğrulama önerilir
# OUT[8] : Review listesi — conf < 0.55 olan elemanlar
#            "REVIEW | Id=... | m2=... | conf=... | reasons=..."
#            Dynamo'da Watch node ile direkt görüntülenebilir.
OUT = [
    elements_out,
    formwork_m2_list,
    debug_list,
    size_list,
    level_list,
    grid_list,
    elemid_list,
    confidence_list,
    review_list,
]
# ----------------------------------------
number = DoubleInput(1)
getItemAtIndex = List.GetItemAtIndex(list=python_script, index=number)
watch = Watch(getItemAtIndex)
number_2 = DoubleInput(0)
getItemAtIndex_2 = List.GetItemAtIndex(list=python_script, index=number_2)
watch_2 = Watch(getItemAtIndex_2)
categories = Categories("OST_StructuralColumns")  # frozen
all_elements_of_category = ElementsOfCategory(Category=categories)  # frozen
categories_2 = Categories("OST_Floors")  # frozen
all_elements_of_category_2 = ElementsOfCategory(Category=categories_2)  # frozen
categories_3 = Categories("OST_StructuralFraming")  # frozen
all_elements_of_category_3 = ElementsOfCategory(Category=categories_3)  # frozen
categories_4 = Categories("OST_StructuralFoundation")  # frozen
all_elements_of_category_4 = ElementsOfCategory(Category=categories_4)  # frozen
categories_5 = Categories("OST_Walls")  # frozen
all_elements_of_category_5 = ElementsOfCategory(Category=categories_5)  # frozen
categories_6 = Categories("OST_Stairs")  # frozen
all_elements_of_category_6 = ElementsOfCategory(Category=categories_6)  # frozen
list_create = List.Create(item0=all_elements_of_category, item1=all_elements_of_category_2, item2=all_elements_of_category_3, item3=all_elements_of_category_4, item4=all_elements_of_category_5, item5=all_elements_of_category_6)  # frozen
flatten = List.Flatten(list=list_create)  # frozen
number_3 = DoubleInput(3)
getItemAtIndex_3 = List.GetItemAtIndex(list=python_script, index=number_3)
watch_3 = Watch(getItemAtIndex_3)
number_4 = DoubleInput(4)
getItemAtIndex_4 = List.GetItemAtIndex(list=python_script, index=number_4)
watch_4 = Watch(getItemAtIndex_4)
number_5 = DoubleInput(5)
getItemAtIndex_5 = List.GetItemAtIndex(list=python_script, index=number_5)
watch_5 = Watch(getItemAtIndex_5)
number_6 = DoubleInput(2)
getItemAtIndex_6 = List.GetItemAtIndex(list=python_script, index=number_6)
watch_6 = Watch(getItemAtIndex_6)
number_7 = DoubleInput(-1)
getItemAtIndex_7 = List.GetItemAtIndex(list=python_script, index=number_7)
watch_7 = Watch(getItemAtIndex_7)
count = List.Count(list=python_script)
watch_8 = Watch(count)
